# Dynamo graph DetailedPreviewMargin_Test.dyn (Dynamo 1.0.0.343)

code_block = CodeBlock { 1; }
code_block_2 = CodeBlock { 2; }
create = List.Create(code_block, code_block_2)
watch = Watch(create)
string = StringInput("abc")
code_block_3 = CodeBlock { 1..10; }
